# Grasshopper definition JsonRetriver_06b+ShortestPathFinder.gh (Grasshopper 1.0.7)

panel = Panel("---")
post_string = Text("projectId=")
url = Text("/rvttransponder_02/html/getProjects.php")
# READ JSON FILE
panel_2 = Panel(url)
get_project_list = PythonScript(URL=url, POST_str=post_string)  # -> out, a
# ---------- get_project_list: Python ----------
import socket
import sys
import binascii
import json

try:
    s = socket.socket(socket.AF_INET, socket.SOCK_STREAM)
    print("sockect successfully create")
except socket.error as err:
    print("socket creation failed with error %s" %(err))

port = 80

s.connect(('flux2o.ml', port))

print("successfully connected")




headers = """\
POST /"""+URL+""" HTTP/1.1\r
Content-Type: {content_type}\r
Content-Length: {content_length}\r
Host: {host}\r
Connection: close\r
\r\n"""


body = POST_str                              
body_bytes = body.encode('ascii')
header_bytes = headers.format(
    content_type="application/x-www-form-urlencoded",
    content_length=len(body_bytes),
    host=str("flus2o.ml") + ":" + str(port)
).encode('iso-8859-1')

payload = header_bytes + body_bytes

s.sendall(payload)

response = s.recv(131072);
response = response.split('\r\n')
last_index = len(response)-1;

a = response[last_index]
# ---------- end get_project_list ----------
python = PythonScript(json_str=get_project_list.a)  # -> out, filename_list, uid_list
# ---------- python: Python ----------
import clr
import json

projects = json.loads(json_str)
if projects is None:
    exit
filenames = []
uids = []
for project in projects:
    print project['filename']
    filenames.append(project['filename'])
    uids.append(project['uid'])
filename_list = filenames
uid_list = uids
# ---------- end python ----------
python_2 = PythonScript()  # -> out, a
# ---------- python_2: Python ----------
import socket
import sys
import binascii

try:
    s = socket.socket(socket.AF_INET, socket.SOCK_STREAM)
    print("sockect successfully create")
except socket.error as err:
    print("socket creation failed with error %s" %(err))

port = 80

s.connect(('127.0.0.1', port))

print("successfully connected")



headers = """\
POST /rvttransponder_02/html/getProjects.php HTTP/1.1\r
Content-Type: {content_type}\r
Content-Length: {content_length}\r
Host: {host}\r
Connection: close\r
\r\n"""

body = 'projectId=8764c51057b744c3bddf266d86c263800000c160'                                 
body_bytes = body.encode('ascii')
header_bytes = headers.format(
    content_type="application/x-www-form-urlencoded",
    content_length=len(body_bytes),
    host=str("localhost") + ":" + str(port)
).encode('iso-8859-1')

payload = header_bytes + body_bytes

s.sendall(payload)

print(s.recv(65536))
# ---------- end python_2 ----------
panel_3 = Panel(get_project_list.a)
list = ValueList({"0", "1", "2", "3"}, selected="0")
bool = Boolean(False)
panel_4 = Panel(python.filename_list)
item = ListItem(List=python.uid_list, Index=list, Wrap=bool)
panel_5 = Panel(item)
txt_projectid = Text(item)
post_string_2 = Text("uid=")
concat = Concatenate(FragmentA=post_string_2, FragmentB=panel_5)
url_2 = Text("/rvttransponder_02/html/getAllProjectData.php")
panel_6 = Panel(url_2)
get_project_list_2 = PythonScript(URL=url_2, POST_str=concat)  # -> out, a
# ---------- get_project_list_2: Python ----------
import socket
import sys
import binascii
import json

try:
    s = socket.socket(socket.AF_INET, socket.SOCK_STREAM)
    print("sockect successfully create")
except socket.error as err:
    print("socket creation failed with error %s" %(err))

port = 80

s.connect(('flux2o.ml', port))

print("successfully connected")




headers = """\
POST /"""+URL+""" HTTP/1.1\r
Content-Type: {content_type}\r
Content-Length: {content_length}\r
Host: {host}\r
Connection: close\r
\r\n"""


body = POST_str                              
body_bytes = body.encode('ascii')
header_bytes = headers.format(
    content_type="application/x-www-form-urlencoded",
    content_length=len(body_bytes),
    host=str("flux2o.ml") + ":" + str(port)
).encode('iso-8859-1')

payload = header_bytes + body_bytes

s.sendall(payload)

response = s.recv(1048576);
jsonstr = response.split('<flux2o>')[1]

#remove extra characters from json
idx_of_last_squarebracket = jsonstr.rfind(']')
a = jsonstr[:idx_of_last_squarebracket+1]
print(a)
# ---------- end get_project_list_2 ----------
python_3 = PythonScript(json_str=get_project_list_2.a)  # -> out, rooms, room_jsons, room_names, room_svgs, room_levels, room_Z, doors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
# ---------- python_3: Python ----------
import clr
import json

projects = json.loads(json_str)
if projects is None:
    exit
categories = []
uids = []
doors = {}
door_jsons = []
door_locations = []
door_levels = []
door_widths = []
door_facing_orientations = []
torooms = []
fromrooms = []
rooms = {}
room_jsons = []
room_svgs = []
room_names = []
room_levels = []
room_Z = []
fe_dict = {}
fe_locations = []
fe_svgs = []
fe_levels = []
fe_roomids = []
for project in projects:
    uid = project['uid']
    uids.append(uid)
    cat =  project['category']
    categories.append(cat)
    if cat=='Doors':
        doors.Add(uid, project)
        door_jsons.append(json.dumps(project))
        rawjson = json.loads(project['rawjson'])
        door_locations.append(rawjson['location'])
        door_levels.append(rawjson['levelName'])
        door_widths.append(rawjson['width'])
        door_facing_orientations.append(rawjson['facingorientation'])
        #print(rawjson['facingorientation'])
        torooms.append(rawjson['toroom'])
        fromrooms.append(rawjson['fromroom'])
    elif cat == 'Rooms':
        rooms.Add(uid,project)
        room_jsons.append(json.dumps(project))
        rawjson = json.loads(project['rawjson'])
        room_names.append(rawjson['name'])
        room_svgs.append(rawjson['svgPaths'])
        room_levels.append(rawjson['levelName'])
        location = rawjson['location']
        #print(location['Z'])
        room_Z.append(location['Z'])
    elif cat == 'Furniture' or cat=='Furniture System' or cat == 'Plumbing Fixtures':
        fe_dict.Add(uid,project)
        rawjson = json.loads(project['rawjson'])
        fe_locations.append(rawjson['location'])
        fe_svgs.append(rawjson['svgPaths'])
        fe_levels.append(rawjson['levelName'])
        fe_roomids.append(rawjson['roomid'])
# ---------- end python_3 ----------
python_4 = PythonScript(svglists=python_3.room_svgs, Z_loc=python_3.room_Z)  # -> out, curveloops
# ---------- python_4: Python ----------
import rhinoscriptsyntax as rs
import scriptcontext as sc
import Rhino as rh

curveloops = []
counter = 0
for list in svglists:
    liststr = str(list)
    liststr = liststr.replace('M','')
    liststr = liststr.replace('Z','')
    pairs = liststr.split(' ')
    pts = []
    for pair in pairs:
        pts.append(rs.Str2Pt(pair+','+str(Z_loc)))
    if pts is not None:
        print(pts)
        pl = rh.Geometry.Polyline(pts)
        if pl.IsValid:
            curveloops.append(rs.AddPolyline(pts))
    print(str(curveloops))
    counter+=1
    print(counter)
# ---------- end python_4 ----------
python_5 = PythonScript(
    door_location=python_3.door_locations,
    door_width=python_3.door_widths,
    door_facing_orientation=python_3.door_facing_orientations)  # -> out, locpt, width, arrow, line, circle
# ---------- python_5: Python ----------
import rhinoscriptsyntax as rs
import scriptcontext as sc
import Rhino as rh

if door_width is not None:
    width = door_width

origin = rs.Str2Pt('0,0,0')
if door_location is not None:
    x = door_location['X']
    y = door_location['Y']
    z = door_location['Z']
    locpt= rs.AddPoint(x,y,z)
    if door_facing_orientation is not None:
        xf = door_facing_orientation['X']
        yf = door_facing_orientation['Y']
        zf = door_facing_orientation['Z']
        pt = rs.AddPoint(xf,yf,zf)
        facing = rs.VectorCreate(pt, origin)
        arrow = rs.VectorAdd(locpt,facing)
        if arrow is not None:
            print(arrow)
            arrow_pt = rs.coerce3dpoint(arrow)
            start_pt = rs.coerce3dpoint(locpt)
            line = rh.Geometry.Line(arrow_pt, start_pt)
            rs.AddLine(arrow_pt, start_pt)
            if width is not None:
                circle = rh.Geometry.Circle(start_pt, width/2)
                rs.AddCircle(start_pt, width)
# ---------- end python_5 ----------
python_6 = PythonScript(svglists=python_3.fe_svgs, location=python_3.fe_locations)  # -> out, curveloops
# ---------- python_6: Python ----------
import rhinoscriptsyntax as rs
import scriptcontext as sc
import Rhino as rh

curveloops = []
counter = 0
Z_loc = location['Z']
if svglists is not None:
    for list in svglists:
        liststr = str(list)
        liststr = liststr.replace('M','')
        liststr = liststr.replace('Z','')
        pairs = liststr.split(' ')
        pts = []
        for pair in pairs:
            pts.append(rs.Str2Pt(pair+','+str(Z_loc)))
        if pts is not None:
            print(pts)
            pl = rh.Geometry.Polyline(pts)
            if pl.IsValid:
                curveloops.append(rs.AddPolyline(pts))
        print(str(curveloops))
        counter+=1
        print(counter)
# ---------- end python_6 ----------
crv_roomboundary = Curve(flatten(python_4.curveloops))
num_roomzlevel = Number(python_3.room_Z)
pt_doorlocations = Point(python_5.locpt)
txt_roomnames = Text(python_3.room_names)
txt_roomguid = Text(python_3.rooms)
crv_roomboundary_2 = Curve(crv_roomboundary)
area = Area(Geometry=crv_roomboundary_2)  # -> Area, Centroid
num_room_zlevel = Number(num_roomzlevel)
pt_doorlocations_2 = Point(pt_doorlocations)
txt_roomnames_2 = Text(txt_roomnames)
panel_7 = Panel(txt_roomnames_2)
txt_room_guid = Text(txt_roomguid)
tag = TextTag3D(Location=area.Centroid, Text=txt_roomnames_2, Size=1, Justification=7)
panel_8 = Panel("""|
|
|""")
txt_roomnames_3 = Text(simplify(graft(txt_roomnames_2)))
cull_i = CullIndex(List=crv_roomboundary_2, Indices="7", Wrap=False)
# WRITE RESULTING PATHS TO JSON FILE
panel_9 = Panel("---")
clean = CleanTree(RemoveNulls=True, RemoveInvalid=True, RemoveEmpty=False, Tree=pt_doorlocations_2)
num_room_zlevel_2 = Number(simplify(graft(num_room_zlevel)))
txt_room_guid_2 = Text(simplify(graft(txt_room_guid)))
crv_roomboundary_3 = Curve(simplify(graft(cull_i)))
# COMPUTE SHORTEST PATHS
item_2 = ListItem(List=crv_roomboundary_2, Index="7", Wrap=True)
pt_doorlocations_3 = Point(clean)
crv_corridor = Curve(item_2)

# ---- group: F I N D R O O M S A N D D O O R S
pt_doorlocations_4 = Point(pt_doorlocations_3)
pdecon = Deconstruct(Point=pt_doorlocations_4)  # -> XComponent, YComponent, ZComponent
num_door_zlevel = Number(pdecon.ZComponent)
sort = SortList(Keys=num_door_zlevel)  # -> Keys, ValuesA
dcon = DeleteConsecutive(Set=sort.Keys, Wrap=False)  # -> Set, Count
panel_10 = Panel("SELECT LEVEL INDEX")
num_uniquezlevels = Number(dcon.Set)
panel_11 = Panel(num_uniquezlevels)
item_3 = ListItem(List=num_uniquezlevels, Index=Slider(0, range=0..10), Wrap=False)
panel_12 = Panel(item_3)
similar = Similarity(FirstNumber=num_room_zlevel_2, SecondNumber=item_3, Threshold=0.1)  # -> Similarity, AbsoluteDifference
similar_2 = Similarity(FirstNumber=num_door_zlevel, SecondNumber=item_3, Threshold=0.1)  # -> Similarity, AbsoluteDifference
tstat = TreeStatistics(Tree=crv_roomboundary_3)  # -> Paths, Length, Count
cull = CullPattern(List=simplify(txt_room_guid_2), CullPattern=simplify(similar.Similarity))
cull_2 = CullPattern(List=tstat.Paths, CullPattern=flatten(similar.Similarity))
cull_3 = CullPattern(List=pt_doorlocations_4, CullPattern=similar_2.Similarity)
branch = TreeBranch(Tree=crv_roomboundary_3, Path=cull_2, MaintainPaths=True)

# ----
panel_13 = Panel("{\"c3644ca1-eced-4e00-9adf-ee2f605bd476\": [\"-44.1470005904012,13.6435238395434,0\", \"-47.12881219439,27.0482671679636,0\"],\"a71125bc-d14a-47b3-b9d6-cb90118f50a9\": [\"-20.1470005904011,34.9483163035146,0\", \"-23.8136672570678,11.6149829701812,0\"],\"28a1aae7-9064-48fd-8243-4c8bbe6d6797\": [\"8.4708763793007,45.0045315188108,0\", \"-19.4803339237345,23.2816496368479,0\"],\"fa1c28c4-2b6c-4e2d-a898-254353c8fc4c\": [\"12.5196660762655,34.9483163035146,0\", \"24.1863327429322,11.6149829701811,0\"],\"c2039d74-dd01-4820-aa8e-86b3adee186a\": [\"-19.4803339237346,-20.3850170298188,0\", \"4.18633274293214,-1.05168369648559,0\"],\"81e9f7c5-3e19-41b8-bae9-0476d56771ea\": [\"12.5196660762654,-20.3850170298188,0\", \"24.1863327429322,-1.05168369648565,0\"],\"6a7b8eea-0349-4f7a-be72-b0bf0db3285d\": [\"-23.8136672570678,10.9483163035145,0\", \"-43.4803339237345,5.2816496368479,0\"],\"ac4630f8-88e3-4dbb-b4db-2a61be8dbaac\": [\"-33.8136672570678,10.9483163035146,0\", \"-43.4803339237345,5.2816496368479,0\"],\"7ae3f746-0cff-44a3-8459-0bbf11c720f1\": [\"4.18633274293214,10.9483163035144,0\", \"35.8529994095988,5.28164963684766,0\"],\"2580eb61-a7f4-4825-8b79-e4d695c0bedd\": [\"24.1863327429322,10.9483163035144,0\", \"35.8529994095988,5.28164963684766,0\"],\"21f3dba0-ebf6-415f-a744-ccda6212094f\": [\"4.18633274293214,-0.385017029818919,0\", \"35.8529994095988,5.28164963684766,0\"],\"d4ba5dd2-1e91-4d14-9f35-9672a3d35fa8\": [\"24.1863327429322,-0.385017029818984,0\", \"35.8529994095988,5.28164963684766,0\"]}")
txt_room_guid_currentlevel = Text(cull)

# ---- group: R O O M S
pt_door_locations_currentlevel = Point(cull_3)
crv_room_outline_currentlevel = Curve(branch)
cull_4 = CullPattern(
    List=crv_room_outline_currentlevel,
    CullPattern=invert([True, False, False, False, False, False, False, False, False, False, False, False, False, False]))
item_4 = ListItem(List=crv_room_outline_currentlevel, Index=0, Wrap=True)
crv_room_outlines = Curve(item_4)
crv_room_obstacles = Curve(cull_4)
assocdoors = AssocDoors(crv_room_outlines=crv_room_outlines, pt_doorpoints=pt_door_locations_currentlevel)  # -> simplify(pt_doorlocation_2)
pt_roomdoors = Point(flatten(assocdoors))
item_5 = ListItem(List=assocdoors, Index=0, Wrap=True)
pt_roomdoors_2 = Point(pt_roomdoors)
circle = CircleCNR(Center=pt_door_locations_currentlevel, Normal=Vector(0, 0, 1), Radius="2.0")
boundary = BoundarySurfaces(Edges=circle)
boundary_2 = BoundarySurfaces(Edges=crv_room_outlines)
shortestpath_list = ShortestPathList(pt_doorlocation=item_5, crv_roomboundary_obstacles=crv_room_outlines)
preview = CustomPreview(Geometry=boundary_2, Material=ColourSwatch(SwatchColor=RGB(0, 0, 255)))
preview_2 = CustomPreview(Geometry=crv_room_obstacles, Material=ColourSwatch(SwatchColor=RGB(128, 128, 255)))
preview_3 = CustomPreview(Geometry=boundary, Material=ColourSwatch(SwatchColor=RGB(128, 255, 128)))
crv_shortestpath = Curve(shortestpath_list)
crv_shortestpaths_rooms = Curve(crv_shortestpath)
len = Length(Curve=crv_shortestpaths_rooms)
expression = Expression(x=len, Expression="Format(\"{0:0.00}\", x)")
pipe = Pipe(Curve=crv_shortestpath, Radius="0.5", Caps=0)
curvepoint = PointOnCurve(crv_shortestpaths_rooms, parameter=0.5)
panel_14 = Panel(shortestpath_list)
preview_4 = CustomPreview(Geometry=pipe, Material=ColourSwatch(SwatchColor=RGB(255, 0, 0)))
tag_2 = TextTag(Location=curvepoint, Text=expression, Colour=ColourSwatch(SwatchColor=RGB(255, 255, 255)))

# ---- group: F I N D E X I T D O O R S
pt_doorlocations_5 = Point(clean)
pt_roomdoors_3 = Point(pt_roomdoors)
circle_2 = CircleCNR(Center=pt_roomdoors_3, Normal=Vector(0, 0, 1), Radius=1)
incurves = PointInCurves(Point=pt_doorlocations_5, Curves=circle_2)  # -> Relationship, Index, Point
equals = Equality(FirstNumber=incurves.Relationship, SecondNumber=0)  # -> Equality, Inequality
cull_5 = CullPattern(List=pt_doorlocations_5, CullPattern=equals.Equality)
pt_exitdoors = Point(cull_5)
pt_exitdoors_2 = Point(pt_exitdoors)

# ----
crv_shortestpaths_rooms_2 = Curve(crv_shortestpaths_rooms)
crv_shortestpaths_rooms_3 = Curve(crv_shortestpaths_rooms_2)

# ---- group: C O R R I D O R
crv_corridor_2 = Curve(crv_corridor)
identify_corridor = IdentifyCorridor(crv_roomboundaries=crv_corridor_2, pt_doorpoints=pt_roomdoors_3, pt_exitdoorpoints=pt_exitdoors)  # -> crv_roomboundary_2, pt_doorlocation_2, pt_exitdoorlocation_2, crv_obstacles_4
boundary_3 = BoundarySurfaces(Edges=identify_corridor.crv_roomboundary_2)
preview_5 = CustomPreview(Geometry=boundary_3, Material=ColourSwatch(SwatchColor=RGB(0, 170, 255)))
shtpath_exit = ShtPathEXIT(
    pt_doorlocation=identify_corridor.pt_doorlocation_2,
    pt_exitdoorlocation=identify_corridor.pt_exitdoorlocation_2,
    crv_roomboundary_obstacles=[identify_corridor.crv_roomboundary_2, identify_corridor.crv_obstacles_4])
crv_shortestpath_2 = Curve(shtpath_exit)
crv_shortestpaths_corridors = Curve(crv_shortestpath_2)
len_2 = Length(Curve=crv_shortestpaths_corridors)
expression_2 = Expression(x=len_2, Expression="Format(\"{0:0.00}\", x)")
crv_shortestpaths_corridors_2 = Curve(crv_shortestpaths_corridors)
curvepoint_2 = PointOnCurve(crv_shortestpaths_corridors, parameter=0.5)
pipe_2 = Pipe(Curve=crv_shortestpath_2, Radius="0.5", Caps=2)
tag_3 = TextTag(Location=curvepoint_2, Text=expression_2, Colour=ColourSwatch(SwatchColor=RGB(255, 255, 255)))
preview_6 = CustomPreview(Geometry=pipe_2, Material=ColourSwatch(SwatchColor=RGB(255, 128, 0)))

# ----
crv_shortestpaths_corridors_3 = Curve(crv_shortestpaths_corridors)
crv_shortestpaths_corridors_4 = Curve(crv_shortestpaths_corridors_3)

clean_2 = CleanTree(RemoveNulls=True, RemoveInvalid=True, RemoveEmpty=False, Tree=crv_shortestpaths_rooms_3)
clean_3 = CleanTree(RemoveNulls=True, RemoveInvalid=True, RemoveEmpty=False, Tree=crv_shortestpaths_corridors_4)
crv_shortestpaths_rooms_4 = Curve(flatten(clean_2))
crv_shortestpaths_rooms_5 = Curve(flatten(clean_3))
explode = Explode(Curve=crv_shortestpaths_rooms_4, Recursive=True)  # -> Segments, Vertices
explode_2 = Explode(Curve=crv_shortestpaths_rooms_5, Recursive=True)  # -> Segments, Vertices
item_6 = ListItem(List=explode.Vertices, Index=0, Wrap=True)  # -> Item, Item1
item_7 = ListItem(List=explode_2.Vertices, Index=0, Wrap=True)  # -> Item, Item1
python_7 = GhPythonScript(i=item_6.Item, j=item_6.Item1)  # -> out, flatten(a)
# ---------- python_7: Python ----------
import json
import rhinoscriptsyntax as rs

# loop through polylines in list
#  for each polyline, loop through points
#  (each polyline should get its own GUID)

output = []

output.append(rs.PointCoordinates(i).ToString())
output.append(rs.PointCoordinates(j).ToString())
# output.append(rs.PointCoordinates(x).ToString())

dict = {}
dict[i.ToString()] = output
a = json.dumps(dict)
# ---------- end python_7 ----------
python_8 = GhPythonScript(i=item_7.Item, j=item_7.Item1)  # -> out, flatten(a); same code as python_7
python_9 = GhPythonScript(x=python_8.a)  # -> out, a
# ---------- python_9: Python ----------
import json
import rhinoscriptsyntax as rs

jsonp = []

a=x
# ---------- end python_9 ----------
merge = Merge(Data1=python_7.a, Data2=python_8.a)

panel_15 = Panel("create json string")
concat_2 = Concatenate(FragmentA=merge, FragmentB=",")
join = TextJoin(Text=concat_2)
len_3 = TextLength(Text=join)
fragment = TextFragment(Text=join, Start="0", Count=expr("x-1", len_3))
rep = ReplaceText(Text=fragment, Find="{", RecursiveReplace=False)
rep_2 = ReplaceText(Text=rep, Find="}", RecursiveReplace=False)
concat_3 = Concatenate(FragmentA="{", FragmentB=rep_2, FragmentC="}")

panel_16 = Panel("/rvttransponder_02/html/setRhinoData.php")
panel_17 = Panel("7cacd49cac174591")
txt_projectid_2 = Text(txt_projectid)
url_3 = Text("/rvttransponder_02/html/setRhinoData.php")
panel_18 = Panel(url_3)
python_10 = PythonScript(projectId=txt_projectid_2, egressPaths=concat_3)  # -> out, output
# ---------- python_10: Python ----------
import json
dict = {}

dict['projectId'] = projectId
dict['egressPaths'] = egressPaths
dict['useCategory'] = 'EGRESS_PATH'

output = json.dumps(dict)
print(output)
# ---------- end python_10 ----------
get_project_list_3 = PythonScript(URL=url_3, POST_str=python_10.output)  # -> out, a
# ---------- get_project_list_3: Python ----------
import socket
import sys
import binascii
import json

try:
    s = socket.socket(socket.AF_INET, socket.SOCK_STREAM)
    print("sockect successfully create")
except socket.error as err:
    print("socket creation failed with error %s" %(err))

port = 80

s.connect(('flux2o.ml', port))

print("successfully connected")




headers = """\
POST /"""+URL+""" HTTP/1.1\r
Content-Type: {content_type}\r
Content-Length: {content_length}\r
Host: {host}\r
Connection: close\r
\r\n"""


body = POST_str                              
body_bytes = body.encode('ascii')
header_bytes = headers.format(
    content_type="application/json",
    content_length=len(body_bytes),
    host=str("flux2o.ml") + ":" + str(port)
).encode('iso-8859-1')

payload = header_bytes + body_bytes

s.sendall(payload)

response = s.recv(131072);
response = response.split('\r\n')
last_index = len(response)-1;

a = response[last_index]
print(a)
# ---------- end get_project_list_3 ----------

panel_19 = Panel(python_10.output)
panel_20 = Panel(get_project_list_3.a)

# ==== cluster ShortestPathList
crv_roomboundary_obstacles = ClusterInput()
pt_doorlocation = ClusterInput()

# ---- group: boundary
crv_roomboundary_obstacles_2 = Curve(crv_roomboundary_obstacles)

# ---- group: door point
pt_doorlocation_2 = Point(pt_doorlocation)

# ----
area = Area(Geometry=crv_roomboundary_obstacles_2)  # -> Area, Centroid
sort = SortList(Keys=area.Area, ValuesA=crv_roomboundary_obstacles_2)  # -> Keys, ValuesA
item = ListItem(List=reverse(sort.ValuesA), Index=0, Wrap=True)
disc = Discontinuity(Curve=item, Level=1)  # -> simplify(Points), Parameters
pt = Point(flatten(disc.Points))
crv_cp = CurveClosestPoint(Point=pt_doorlocation_2, Curve=item)  # -> Point, Parameter, Distance
merge = Merge(Data1=crv_roomboundary_obstacles_2)
disc_2 = Discontinuity(Curve=merge, Level=1)  # -> Points, Parameters
pt_2 = Point(graft(pt))
pshift = ShiftPaths(Data=disc_2.Points, Offset=-1)

# ---- group: all corners
pt_3 = Point(pshift)

# ----
merge_2 = Merge(Data1=flatten(pt_2), Data3=flatten(pt_3), Data4=flatten(crv_cp.Point))
merge_3 = Merge(Data1=disc.Points, Data2=pt_3, Data3=crv_cp.Point)
crossref = CrossReference(ListA=merge_3, ListB=merge_3, CrossMode=1)  # -> ListA, ListB
ln = Line(StartPoint=disc.Points, EndPoint=crv_cp.Point)

# ---- group: remove lines through walls
ln_2 = Line(StartPoint=crossref.ListA, EndPoint=crossref.ListB)
ccx = CurveCurve(CurveA=ln_2, CurveB=merge)  # -> Points, ParamsA, ParamsB
lng = ListLength(List=ccx.Points)  # -> flatten(Length)
larger = LargerThan(FirstNumber=lng, SecondNumber="2")  # -> LargerThan, OrEqualTo
cull = CullPattern(List=ln_2, CullPattern=invert(larger.LargerThan))

# ----
panel = Panel("25")
boundary = BoundarySurfaces(Edges=merge)
line = Line(cull)
tstat = TreeStatistics(Tree=line)  # -> Paths, graft(Length), Count
# find lines which are completely contained in the surface/room
divide = DivideCurve(Curve=line, Count="100", Kinks=False)  # -> Points, Tangents, Parameters
repeat = RepeatData(Data=boundary, Length=expr("x-1", tstat.Length))  # -> simplify(Data)
srf_cp = SurfaceClosestPoint(Point=divide.Points, Surface=graft(repeat))  # -> Point, UVPoint, Distance
ma = MassAddition(Input=srf_cp.Distance)  # -> Result, PartialResults
larger_2 = LargerThan(FirstNumber=ma.Result, SecondNumber=0.001)  # -> LargerThan, OrEqualTo
line_2 = Line(ln)
pshift_2 = ShiftPaths(Data=larger_2.LargerThan, Offset=-1)
cull_2 = CullPattern(List=line, CullPattern=invert(pshift_2))
line_3 = Line(cull_2)
shortwalk = ShortestWalk(Curves=line_3, WantedPath=line_2)  # -> ShortestWalk, Succession, Direction, Length
panel_2 = Panel(ma.Result)
crv = Curve(shortwalk.ShortestWalk)
flatten = FlattenTree(Tree=crv, Path="{0}")
len = Length(Curve=crv)
sort_2 = SortList(Keys=len, ValuesA=crv)  # -> Keys, ValuesA
panel_3 = Panel(line_3)
item_2 = ListItem(List=reverse(sort_2.ValuesA), Index=0, Wrap=True)
crv_longest_shortestpath = Curve(item_2)
crv_longest_shortestpath_2 = ClusterOutput(crv_longest_shortestpath)

# ==== cluster AssocDoors
pt_doorpoints = ClusterInput()
pt_doorpoints_2 = Point(pt_doorpoints)
crv_room_outlines = ClusterInput()
crv_room_outlines_2 = Curve(crv_room_outlines)
panel = Panel("""1
-1""")
offset = OffsetCurve(Curve=crv_room_outlines_2, Distance=panel, Plane=PlaneXY(0, 0, 0), Corners=1)  # -> simplify(graft(Curve))
pshift = ShiftPaths(Data=offset, Offset=-1)
area = Area(Geometry=pshift)  # -> Area, Centroid
sort = SortList(Keys=area.Area, ValuesA=pshift)  # -> Keys, ValuesA
item = ListItem(List=reverse(sort.ValuesA), Index=0, Wrap=True)
findpointinsidecurve = FindPointInsideCurve(pt_set=pt_doorpoints_2, crv_testcurve=item)
pt_doorlocation = Point(findpointinsidecurve)
pt_doorlocation_2 = ClusterOutput(pt_doorlocation)

# ==== cluster IdentifyCorridor
pt_exitdoorpoints = ClusterInput()
crv_roomboundaries = ClusterInput()
crv_obstacles = ClusterInput()
pt_doorpoints = ClusterInput()
pt_exitdoorpoints_2 = Point(pt_exitdoorpoints)
pt_doorpoints_2 = Point(pt_doorpoints)
crv_roomboundaries_2 = Curve(crv_roomboundaries)
crv_obstacles_2 = Curve(crv_obstacles)
panel = Panel("A")
panel_2 = Panel("""12
-12""")
offset = OffsetCurve(Curve=crv_roomboundaries_2, Distance=panel_2, Plane=PlaneXY(0, 0, 0), Corners=1)
pshift = ShiftPaths(Data=offset, Offset=-1)
area = Area(Geometry=pshift)  # -> Area, Centroid
sort = SortList(Keys=area.Area, ValuesA=pshift)  # -> Keys, ValuesA
item = ListItem(List=reverse(sort.ValuesA), Index=0, Wrap=True)
findcurvesinsideboundary = FindCurvesInsideBoundary(crv_boundary=crv_roomboundaries_2, crv_subcurves=crv_obstacles_2)
findpointinsidecurve = FindPointInsideCurve_2(pt_set=pt_exitdoorpoints_2, crv_testcurve=item)
findpointinsidecurve_2 = FindPointInsideCurve_2(pt_set=pt_doorpoints_2, crv_testcurve=item)
pt_doorlocation = Point(findpointinsidecurve_2)
crv_roomboundary = Curve(crv_roomboundaries_2)
pt_exitdoorlocation = Point(findpointinsidecurve)
crv_obstacles_3 = Curve(findcurvesinsideboundary)
pt_doorlocation_2 = ClusterOutput(pt_doorlocation)
crv_roomboundary_2 = ClusterOutput(crv_roomboundary)
crv_obstacles_4 = ClusterOutput(crv_obstacles_3)
pt_exitdoorlocation_2 = ClusterOutput(pt_exitdoorlocation)

# ==== cluster ShtPathEXIT
pt_exitdoorlocation = ClusterInput()
pt_doorlocation = ClusterInput()
crv_roomboundary_obstacles = ClusterInput()

# ---- group: boundary
crv_roomboundary_obstacles_2 = Curve(crv_roomboundary_obstacles)

# ----
pt_exitdoorlocation_2 = Point(pt_exitdoorlocation)

# ---- group: door point
pt_doorlocation_2 = Point(pt_doorlocation)

# ----
area = Area(Geometry=crv_roomboundary_obstacles_2)  # -> Area, Centroid
sort = SortList(Keys=area.Area, ValuesA=crv_roomboundary_obstacles_2)  # -> Keys, ValuesA
item = ListItem(List=reverse(sort.ValuesA), Index=0, Wrap=True)
disc = Discontinuity(Curve=item, Level=1)  # -> Points, Parameters
crv_cp = CurveClosestPoint(Point=pt_doorlocation_2, Curve=item)  # -> Point, Parameter, Distance
crv_cp_2 = CurveClosestPoint(Point=pt_exitdoorlocation_2, Curve=item)  # -> Point, Parameter, Distance
pt = Point(flatten(crv_cp.Point))
merge = Merge(Data1=crv_roomboundary_obstacles_2)
disc_2 = Discontinuity(Curve=merge, Level=1)  # -> Points, Parameters
pt_2 = Point(graft(pt))

# ---- group: all corners
pt_3 = Point(disc_2.Points)

# ----
merge_2 = Merge(Data1=flatten(pt_2), Data2=flatten(crv_cp_2.Point), Data3=flatten(pt_3), Data4=flatten(crv_cp.Point))
crossref = CrossReference(ListA=merge_2, ListB=merge_2, CrossMode=1)  # -> ListA, ListB
ln = Line(StartPoint=pt_2, EndPoint=crv_cp_2.Point)

# ---- group: remove lines through walls
ln_2 = Line(StartPoint=crossref.ListA, EndPoint=crossref.ListB)
ccx = CurveCurve(CurveA=ln_2, CurveB=merge)  # -> Points, ParamsA, ParamsB
lng = ListLength(List=ccx.Points)  # -> flatten(Length)
larger = LargerThan(FirstNumber=lng, SecondNumber="2")  # -> LargerThan, OrEqualTo
cull = CullPattern(List=ln_2, CullPattern=invert(larger.LargerThan))

# ----
# find lines which are completely contained in the surface/room
line = Line(cull)
panel = Panel("25")
boundary = BoundarySurfaces(Edges=merge)
line_2 = Line(cull)
divide = DivideCurve(Curve=line_2, Count="100", Kinks=False)  # -> Points, Tangents, Parameters
srf_cp = SurfaceClosestPoint(Point=divide.Points, Surface=boundary)  # -> Point, UVPoint, Distance
ma = MassAddition(Input=srf_cp.Distance)  # -> flatten(Result), PartialResults
larger_2 = LargerThan(FirstNumber=ma.Result, SecondNumber=0.001)  # -> LargerThan, OrEqualTo
line_3 = Line(simplify(ln))
cull_2 = CullPattern(List=line_2, CullPattern=invert(larger_2.LargerThan))
line_4 = Line(cull_2)
shortwalk = ShortestWalk(Curves=line_4, WantedPath=line_3)  # -> ShortestWalk, Succession, Direction, Length
crv = Curve(shortwalk.ShortestWalk)
flatten = FlattenTree(Tree=crv, Path="{0}")
len = Length(Curve=crv)
panel_2 = Panel(len)
sort_2 = SortList(Keys=len, ValuesA=crv)  # -> Keys, ValuesA
item_2 = ListItem(List=sort_2.ValuesA, Index=0, Wrap=True)  # -> flatten(Item)
crv_shortestpath_from_all_doors = Curve(flatten)
crv_shortestpath_to_closestdoor = Curve(item_2)
crv_shortestpath_to_closestdoor_2 = ClusterOutput(crv_shortestpath_to_closestdoor)

# ==== cluster FindPointInsideCurve
pt_set = ClusterInput()
crv_testcurve = ClusterInput()
crv_testcurve_2 = Curve(crv_testcurve)
pt_set_2 = Point(pt_set)

# ----
# CONTAINMENT:
# find point (from set) inside a curve
# need the structure of the result to be the same as the curve input structure
incurve = PointInCurve(Point=pt_set_2, Curve=crv_testcurve_2)  # -> Relationship, Point
match = MatchTree(Tree=incurve.Relationship, Guide=crv_testcurve_2)

equals = Equality(FirstNumber=match, SecondNumber=2)  # -> Equality, Inequality
cull = CullPattern(List=pt_set_2, CullPattern=equals.Equality)
match_2 = MatchTree(Tree=cull, Guide=crv_testcurve_2)
pt = Point(match_2)
pt_2 = ClusterOutput(pt)

# ==== cluster FindPointInsideCurve_2
pt_set = ClusterInput()
crv_testcurve = ClusterInput()
crv_testcurve_2 = Curve(crv_testcurve)
# CONTAINMENT:
# find point (from set) inside a curve
pt_set_2 = Point(pt_set)
incurve = PointInCurve(Point=pt_set_2, Curve=crv_testcurve_2)  # -> Relationship, Point
equals = Equality(FirstNumber=incurve.Relationship, SecondNumber=2)  # -> Equality, Inequality
cull = CullPattern(List=pt_set_2, CullPattern=equals.Equality)
pt = Point(cull)
pt_2 = ClusterOutput(pt)

# ==== cluster FindCurvesInsideBoundary
crv_subcurves = ClusterInput()
crv_boundary = ClusterInput()
crv_subcurves_2 = Curve(crv_subcurves)
crv_boundary_2 = Curve(crv_boundary)
area = Area(Geometry=crv_subcurves_2)  # -> Area, Centroid
incurve = PointInCurve(Point=area.Centroid, Curve=crv_boundary_2)  # -> Relationship, Point
equals = Equality(FirstNumber=incurve.Relationship, SecondNumber=2)  # -> Equality, Inequality
cull = CullPattern(List=crv_subcurves_2, CullPattern=equals.Equality)
crv = Curve(cull)
crv_2 = ClusterOutput(crv)
