# Dynamo graph get_updates_to_revit.dyn (Dynamo 2.0.1.5055)

http_endpoint = CodeBlock { "flux2o.ml"; "1Kz15Pg8r7BBG92PtUAIRG"; }

# group: GET POINTS FROM WWW
get_http_output = Python(IN[0]=http_endpoint.out0, IN[1]=http_endpoint.out1)
# ---------- get_http_output.python (50 lines) ----------
import socket
import sys
import binascii

# The inputs to this node will be stored as a list in the IN variables.
dataEnteringNode = IN

http_endpoint = IN[0]

try:
    s = socket.socket(socket.AF_INET, socket.SOCK_STREAM)
    print("sockect successfully created")
except socket.error as err:
    print("socket creation failed with error %s" %(err))

port = 80

s.connect((http_endpoint, port))

print("successfully connected")



headers = """\
POST /rvttransponder_02/html/getUpdates.php HTTP/1.1\r
Content-Type: {content_type}\r
Content-Length: {content_length}\r
Host: {host}\r
Connection: close\r
\r\n"""

body = 'uid='+IN[1]+'&query=GET_UPDATES'                                 
#body = 'uid=1Kz15Pg8r7BBG92PtUAIRG&query=GET_UPDATES'                                 
body_bytes = body.encode('ascii')
header_bytes = headers.format(
    content_type="application/x-www-form-urlencoded",
    content_length=len(body_bytes),
    host=str(http_endpoint) + ":" + str(port)
).encode('iso-8859-1')

payload = header_bytes + body_bytes

s.sendall(payload)

#print(s.recv(65536))



# Assign your output to the OUT variable.
OUT = s.recv(131072)
# ----------------------------------------
magic_splitter_string = CodeBlock { "<flux2o>"; }
split = String.Split(str=get_http_output, separater0=magic_splitter_string)
watch = Watch(split)
lastItem = List.LastItem(list=split)
json_to_list = Python(IN[0]=lastItem)
# ---------- json_to_list.python (34 lines) ----------
import sys
sys.path.append("C:\Program Files (x86)\IronPython 2.7\Lib")
import json

# Enable Python support and load DesignScript library
import clr
clr.AddReference('ProtoGeometry')
from Autodesk.DesignScript.Geometry import *


# The inputs to this node will be stored as a list in the IN variables.
dataEnteringNode = IN

# Place your code below this line
line_segments = []
ptarrays = json.loads(IN[0])
for ptarray in ptarrays:
	linepts_str = json.loads(ptarray['pointjson'])
	# get individual coordinates
	path =[]
	for ptstr in linepts_str:
		pts = ptstr.split(',')
		pt = []
		for num in pts:
			# convert string to float
			pt.append(float(num))
		cartesian_pt = Point.ByCoordinates(pt[0],pt[1],pt[1])
		path.append(cartesian_pt)
	line_segments.append(path)
	


# Assign your output to the OUT variable.
OUT = line_segments;
# ----------------------------------------
watch_2 = Watch(json_to_list)

# group: DRAW LINES
firstItem = List.FirstItem()  # unwired: list
map = List.Map(list=json_to_list, f_x=firstItem)
lastItem_2 = List.LastItem()  # unwired: list
map_2 = List.Map(list=json_to_list, f_x=lastItem_2)
byStartPointEndPoint = Line.ByStartPointEndPoint(startPoint=map, endPoint=map_2)
